# Grasshopper definition PolarArray_cones_001_gh_ss.gh (Grasshopper 1.0.8)

number_slider = Slider(12, range=0..100)
xy_plane = XYPlane(Origin=Point(0, 0, 0))
cone = Cone(Base=xy_plane, Radius=number_slider, Length=number_slider)  # -> Cone, Tip
unit_x = UnitX(Factor=Slider(12, range=0..100))
move = Move(Geometry=cone.Cone, Motion=unit_x)  # -> Geometry, Transform
polar_array = PolarArray(Geometry=move.Geometry, Plane=PlaneXY(0, 0, 0), Count="10", Angle=6.283185307)  # -> Geometry, Transform
